# Grasshopper definition components_tutorial.gh (Grasshopper 1.0.7)
# plug-ins: Objectivism

# ----
# Create Object
# The component's nickname provides a
# "Type Name" - this adds some extra
# information to the object and allows objects
# of different types to be filtered in the "filter by
# type" component
# Literally anything can be put in an object:
# - Geometry
# - Text, numbers, colours
# - Plugin data
# More geometry has its
# preview hidden here. (See
# right click menu)
# Properties can be items, lists or trees, just
# right click on the parameter and select the
# access, just like in the Python or C#
# components
panel = Panel("3")
# Objectivism Components Tutorial
# All components found in the Sets tab of the menu
panel_2 = Panel("Hello World")
series = Series(Start=0, Step=1, Count=panel)
crv = Curve(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)
brep = Brep(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)
customtypename = CreateObject(ItemProperty=panel_2, ListProperty=series, Geometry=brep, MoreGeometry=crv)
panel_3 = Panel(customtypename)
obj = Data(customtypename)

# ----
# (Alternatively use Add/Change, this is the
# same but you cannot change the type name)
# Inherit
# Similar to Create Object, except you add
# extra properties to an existing object, or
# change existing ones
# Give a new type name for the inherited type
obj_2 = Data(obj)
typewithcolour = Inherit(O=obj_2, Colour=ColourSwatch(SwatchColor=RGB(91, 240, 123)), ItemProperty="Hello Again")
merge = Merge(Data1=obj_2, Data2=typewithcolour)
obj_before_after = Data(merge)

# ----
# Object to tree
# Turns the object into a tree, with the first
# index of each branch path corresponding to
# the property. Also provided is a
# corresponding tree of property names
obj_before_after_2 = Data(obj_before_after)
totree = ObjectToTree(Object=obj_before_after_2)  # -> Tree, PropertyNames
property_names = Panel(totree.PropertyNames)
data = Panel(totree.Tree)

# ----
# Filter by type
# Filters objects into different streams based
# on the type name. Graft on the way in is
# turned on by default so order/structure of
# the data is retained and you don't end up
# with lots of annoying nulls
panel_4 = Panel("abc")
obj_before_after_3 = Data(obj_before_after)
hasitem = CreateObject(ItemProperty=panel_4)
filter = FilterByType(Object=graft([hasitem, obj_before_after_3]))  # -> CustomeTypeName, HasItem

# ----
# Get Object Properties
# Retrieve as many properties from an object as you
# desire. Zoom in and use the + buttons to get more
# properties. Or right click and press "Full Explode"
# to get everything.
# Notice the data structure has been grafted so each list from the list
# property has its own branch. This is not done for the item properties
# as we are in "Graft lists + trees" mode. Right click and press "Graft all
# properties" to enter that mode. The item properties will also have
# been grafted and the tree structures will align
obj_before_after_4 = Data(obj_before_after)
multipletypes = GetObjectProperties(Object=obj_before_after_4, GraftItemsToggle=False)  # -> ItemProperty, Colour, ListProperty
panel_5 = Panel(multipletypes.ListProperty)
panel_6 = Panel(multipletypes.ItemProperty)
panel_7 = Panel(multipletypes.Colour)

# ----
# Internalised object
# Objects can be internalised - though note if
# using plugins which do not support
# serialization (reading/writing data to disk) -
# the plugin data will be lost.
obj_3 = Data(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)

# ----
# Test if implements
# Note: Implenents is only checking the names, and
# access level of properties, not their contents, I could
# put a number, a colour, text, anything into the "Colour"
# property and the Implements test is not affected.
# HasColour does not implement the other types,
# as it does not have all their properties
# TypeWithColour implements HasColour, as
# it has a colour property
panel_8 = Panel("""BLUE

Ceci n'est pas une couleur""")
obj_before_after_5 = Data(obj_before_after)
panel_9 = Panel(obj_before_after_5)
hascolour = CreateObject(Property=panel_8)
implements = Implements(Template=hascolour, Object=obj_before_after_5)
implements_2 = Implements(Template=obj_before_after_5, Object=hascolour)
panel_10 = Panel(implements)
panel_11 = Panel(implements_2)
