# Grasshopper definition example_01.gh (Grasshopper 1.0.7)
# plug-ins: Objectivism

# ----
# Create some objects
panel = Panel("""Food
Bread""")
# Objectivism Example 01
# Two  different types for storing geometry
# and extra data have been created:
# - BrepPlus
# - CurvePlus
panel_2 = Panel("Bagel")
panel_3 = Panel("""Solid
Steel""")
brep = Brep(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)
brep_2 = Brep(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)
crv = Curve(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)
brepplus = CreateObject(Geometry=brep_2, Name=panel_2, Colour=ColourSwatch(SwatchColor=RGB(148, 90, 43)), Tags=panel)
brepplus_2 = CreateObject(Geometry=brep, Name="Random Shape", Colour=ColourSwatch(SwatchColor=RGB(177, 178, 150)), Tags=panel_3)
curveplus = CreateObject(Geometry=crv, Name="Wire", Colour=ColourSwatch(SwatchColor=RGB(35, 204, 181)), Tags="Steel")

geometry_plus = Data([brepplus, brepplus_2, curveplus])

# ----
# Apply transform to objects. All geometry
# within an object is transformed
new_axis_rectangle = Curve(<curve referenced from the Rhino model>)
rec = Rectangle(new_axis_rectangle)
drec = DeconstuctRectangle(Rectangle=rec)  # -> BasePlane, XInterval, YInterval
orient = Orient(Geometry=geometry_plus, Source=PlaneXY(0, 0, 0), Target=drec.BasePlane)  # -> Geometry, Transform

# ----
# Filter objects based on type, then find volume for breps and add this
# as a property. The CurvePlus object will not have this property.
filter = FilterByType(Object=graft(orient.Geometry))  # -> CurvePlus, BrepPlus
brepplus_3 = GetObjectProperties(Object=filter.BrepPlus, GraftItemsToggle=False)
volume = Volume(Geometry=brepplus_3)  # -> Volume, Centroid
add_change = AddOrChangeProperties(Object=filter.BrepPlus, PropertyToChange=volume.Volume)
merge = Merge(Data1=filter.CurvePlus, Data2=add_change)
trim = TrimTree(Tree=merge, Depth=1)

# ----
# Accessing the new volume property
multipletypes = GetObjectProperties(Object=trim, GraftItemsToggle=False)  # -> Name, Volume
panel_4 = Panel(multipletypes.Name)
panel_5 = Panel(multipletypes.Volume)

# ----
# Filter objects based on critera - in this case
# we will only have objects with the steel tag
multipletypes_2 = GetObjectProperties(Object=trim, GraftItemsToggle=False)
subset = SubSet(SetA=multipletypes_2, SetB="Steel")
trim_2 = TrimTree(Tree=subset, Depth=1)
cull = CullPattern(List=trim, CullPattern=trim_2)

# ----
# Preview using object's colour
multipletypes_3 = GetObjectProperties(Object=cull, GraftItemsToggle=False)  # -> Geometry, Colour
preview = CustomPreview(Geometry=multipletypes_3.Geometry, Material=multipletypes_3.Colour)
