# Grasshopper definition full-test-suite-manual-tests-done.gh (Grasshopper 1.0.7)
# plug-ins: Objectivism, Telepathy

# ----
# Polymorphism tests
number_slider = Slider(36, range=0..100)
person = CreateObject(FullName="Babs", AgeInYears=Slider(67, range=0..100))
person_2 = CreateObject(FullName="Bob", AgeInYears=number_slider)
coder = Inherit(Object=person, FavouriteLanguage="BrainF**k")
add_change = AddOrChangeProperties(Object=person_2, PropertyToChange="Bill")
implements = Implements(Template=person, Object=coder)
implements_2 = Implements(Template=coder, Object=person)
filter = FilterByType(Object=graft([add_change, coder]))  # -> Person, Coder
not = GateNot(A=implements_2)
panel = Panel(implements)
panel_2 = Panel(not)
assert_implements = RemoteSender(implements)
assert_implements_2 = RemoteSender(not)
coder_2 = GetObjectProperties(Object=filter.Coder, GraftItemsToggle=False)
person_3 = GetObjectProperties(Object=filter.Person, GraftItemsToggle=False)
color = GhPythonScript(panel=panel)  # inputs panel: Boolean
# ---------- color: Python ----------
import System.Drawing as sd



color = sd.Color.FromArgb(255,0,255,0) if panel else sd.Color.Red

ghenv.Component.Params.Input[0].Sources[0].Properties.Colour = color
# ---------- end color ----------
color_2 = GhPythonScript(panel=panel_2)  # inputs panel: Boolean; same code as color
tmatch = MatchText(Text=coder_2, Pattern="Babs", Case=True)
tmatch_2 = MatchText(Text=person_3, Pattern="Bill", Case=True)
panel_3 = Panel(tmatch)
panel_4 = Panel(tmatch_2)
assert_namewaschanged = RemoteSender(tmatch_2)
assert_isbabs = RemoteSender(tmatch)
color_3 = GhPythonScript(panel=panel_3)  # inputs panel: Boolean; same code as color
color_4 = GhPythonScript(panel=panel_4)  # inputs panel: Boolean; same code as color

# ----
# Tree behaviour tests
number_slider_2 = Slider(5, range=0..10)
series = Series(Start=0, Step=1, Count=Slider(3, range=0..10))
series_2 = Series(Start=0, Step=1, Count=Slider(5, range=0..10))
trim = TrimTree(Tree=series, Depth=1)  # -> graft(Tree)
series_3 = Series(Start=trim, Step=1, Count=Slider(5, range=0..10))
trim_2 = TrimTree(Tree=series_3, Depth=1)
object = CreateObject(Item=number_slider_2, List=series_2, Tree=trim_2)
merge = Merge(Data1=object, Data2=object)
entwine = Entwine(Branch00=object, Branch01=merge, FlattenInputs=True)
object_2 = GetObjectProperties(Object=entwine, GraftItemsToggle=True)  # -> Item, List, Tree
object_3 = GetObjectProperties(Object=entwine, GraftItemsToggle=False)
lng = ListLength(List=entwine)
lng_2 = ListLength(List=object_3)
totree = ObjectToTree(Object=object)  # -> Tree, PropertyNames
correctdata = Data(Tree({0;0;0;0}: [5], {1;0;0;0}: [0, 1, 2, 3, 4], {2;0;0;0;0;0}: [0, 1, 2, 3, 4], {2;0;0;0;0;1}: [1, 2, 3, 4, 5], {2;0;0;0;0;2}: [2, 3, 4, 5, 6]))
item = TreeItem(Tree=object_2.Tree, Path="{0;1;1;0;1}", Index=0, Wrap=True)
equals = Equality(FirstNumber=lng_2, SecondNumber=lng)  # -> Equality, Inequality
branch = TreeBranch(Tree=object_2.Item, Path="{0;1;1}", MaintainPaths=True)
branch_2 = TreeBranch(Tree=object_2.List, Path="{0;1;1}", MaintainPaths=True)
equals_2 = Equality(FirstNumber=totree.Tree, SecondNumber=correctdata)  # -> Equality, Inequality
lng_3 = ListLength(List=branch)
lng_4 = ListLength(List=branch_2)
mm = MassMultiplication(Input=flatten(equals.Equality))  # -> Result, PartialResults
equals_3 = Equality(FirstNumber=item, SecondNumber=1)  # -> Equality, Inequality
mm_2 = MassMultiplication(Input=flatten(equals_2.Equality))  # -> Result, PartialResults
equals_4 = Equality(FirstNumber=lng_3, SecondNumber=1)  # -> Equality, Inequality
equals_5 = Equality(FirstNumber=lng_4, SecondNumber=5)  # -> Equality, Inequality
bool = Boolean(mm.Result)
bool_2 = Boolean(mm_2.Result)
panel_5 = Panel(bool_2)
assert_itemgraftedaccess = RemoteSender(bool_2)
panel_6 = Panel(equals_4.Equality)
panel_7 = Panel(equals_5.Equality)
assert_treeaccess = RemoteSender(equals_3.Equality)
assert_itemaccessworks = RemoteSender(bool)
assert_itemgraftedaccess_2 = RemoteSender(equals_4.Equality)
assert_listaccess = RemoteSender(equals_5.Equality)
panel_8 = Panel(equals_3.Equality)
panel_9 = Panel(bool)
color_5 = GhPythonScript(panel=panel_5)  # inputs panel: Boolean; same code as color
color_6 = GhPythonScript(panel=panel_6)  # inputs panel: Boolean; same code as color
color_7 = GhPythonScript(panel=panel_7)  # inputs panel: Boolean; same code as color
color_8 = GhPythonScript(panel=panel_8)  # inputs panel: Boolean; same code as color
color_9 = GhPythonScript(panel=panel_9)  # inputs panel: Boolean; same code as color

# ----
# Transform
# Test transforms and morphs using internalised geometry
# Morph
subd = SubD(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)
crv = Curve(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)
brep = Brep(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)
mesh = Mesh(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)
pt = Point(Point(19.68175559, -7.131460642, 0))
object_4 = CreateObject(Brep=brep, SubD=subd, Mesh=mesh, Pt=pt, Crv=crv)
merge_2 = Merge(Data1=brep, Data2=subd, Data3=mesh, Data4=pt, Data5=crv)
group = Group(Objects=merge_2)
object_5 = GetObjectProperties(Object=object_4, GraftItemsToggle=False)  # -> Brep, SubD, Mesh, Pt, Crv
null = NullItem(Item=flatten([object_5.Brep, object_5.SubD, object_5.Mesh, object_5.Pt, object_5.Crv]))  # -> NullFlags, InvalidFlags, Description
ma = MassAddition(Input=null.NullFlags)  # -> Result, PartialResults
equals_6 = Equality(FirstNumber=ma.Result, SecondNumber=0)  # -> Equality, Inequality
assert_notnull = RemoteSender(equals_6.Equality)
panel_10 = Panel(equals_6.Equality)
color_10 = GhPythonScript(panel=panel_10)  # inputs panel: Boolean; same code as color
xz = XZPlane(Origin=Point(0, 0, 0))
crv_2 = Curve(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)
mirror = Mirror(Geometry=group, Plane=xz)  # -> Geometry, Transform
mirror_2 = Mirror(Geometry=object_4, Plane=xz)  # -> Geometry, Transform
bend = BendDeform(Geometry=group, BendingArc=crv_2)
bend_2 = BendDeform(Geometry=object_4, BendingArc=crv_2)
object_6 = GetObjectProperties(Object=mirror_2.Geometry, GraftItemsToggle=False)  # -> Brep, SubD, Mesh, Pt, Crv
object_7 = GetObjectProperties(Object=bend_2, GraftItemsToggle=False)  # -> Brep, SubD, Mesh, Pt, Crv
merge_3 = Merge(Data1=object_6.Brep, Data2=object_6.SubD, Data3=object_6.Mesh, Data4=object_6.Pt, Data5=object_6.Crv)
merge_4 = Merge(Data1=object_7.Brep, Data2=object_7.SubD, Data3=object_7.Mesh, Data4=object_7.Pt, Data5=object_7.Crv)
ungroup = Ungroup(Group=mirror.Geometry)
ungroup_2 = Ungroup(Group=bend)
entwine_2 = Entwine(Branch00=ungroup, Branch01=ungroup_2, FlattenInputs=True)
entwine_3 = Entwine(Branch00=merge_3, Branch01=merge_4, FlattenInputs=True)
bbox = BoundingBox(Content=entwine_2, Plane=PlaneXY(0, 0, 0))  # -> Box, Box_2
bbox_2 = BoundingBox(Content=entwine_3, Plane=PlaneXY(0, 0, 0))  # -> Box, Box_2
null_2 = NullItem(Item=entwine_3)  # -> NullFlags, InvalidFlags, Description
ma_2 = MassAddition(Input=flatten(null_2.NullFlags))  # -> Result, PartialResults
boxprop = BoxProperties(Box=bbox_2.Box)  # -> Center, Diagonal, Area, Volume, Degeneracy
boxprop_2 = BoxProperties(Box=bbox.Box)  # -> Center, Diagonal, Area, Volume, Degeneracy
equals_7 = Equality(FirstNumber=ma_2.Result, SecondNumber=0)  # -> Equality, Inequality
dist = Distance(PointA=boxprop_2.Center, PointB=boxprop.Center)
assert_notnull_2 = RemoteSender(equals_7.Equality)
panel_11 = Panel(equals_7.Equality)
ma_3 = MassAddition(Input=flatten(dist))  # -> Result, PartialResults
smaller = SmallerThan(FirstNumber=ma_3.Result, SecondNumber="0.0001")  # -> SmallerThan, OrEqualTo
color_11 = GhPythonScript(panel=panel_11)  # inputs panel: Boolean; same code as color
assert_insameplace = RemoteSender(smaller.SmallerThan)
panel_12 = Panel(smaller.SmallerThan)
color_12 = GhPythonScript(panel=panel_12)  # inputs panel: Boolean; same code as color

# ----
# Referenced geometry - requires rhino file to be open
subd_2 = SubD(<subd referenced from the Rhino model>)
mesh_2 = Mesh(<mesh referenced from the Rhino model>)
pt_2 = Point(<point referenced from the Rhino model>)
crv_3 = Curve(<curve referenced from the Rhino model>)
brep_2 = Brep(<brep referenced from the Rhino model>)
object_8 = CreateObject(Brep=brep_2, SubD=subd_2, Mesh=mesh_2, Pt=pt_2, Crv=crv_3)
object_9 = GetObjectProperties(Object=object_8, GraftItemsToggle=False)  # -> Brep, SubD, Mesh, Pt, Crv
null_3 = NullItem(Item=flatten([object_9.Brep, object_9.SubD, object_9.Mesh, object_9.Pt, object_9.Crv]))  # -> NullFlags, InvalidFlags, Description
ma_4 = MassAddition(Input=null_3.NullFlags)  # -> Result, PartialResults
equals_8 = Equality(FirstNumber=ma_4.Result, SecondNumber=0)  # -> Equality, Inequality
assert_referencedgeometrynotnull = RemoteSender(equals_8.Equality)
panel_13 = Panel(equals_8.Equality)
color_13 = GhPythonScript(panel=panel_13)  # inputs panel: Boolean; same code as color

# ----
# Internalised object tests
internalised_object = Data(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)
object_10 = GetObjectProperties(Object=internalised_object, GraftItemsToggle=False)  # -> Name, Brep, SubD, Mesh, Pt, Crv
null_4 = NullItem(Item=flatten([object_10.Brep, object_10.SubD, object_10.Mesh, object_10.Pt, object_10.Crv, object_10.Name]))  # -> NullFlags, InvalidFlags, Description
ma_5 = MassAddition(Input=null_4.NullFlags)  # -> Result, PartialResults
equals_9 = Equality(FirstNumber=ma_5.Result, SecondNumber=0)  # -> Equality, Inequality
assert_internalisedgeometrynotnull = RemoteSender(equals_9.Equality)
panel_14 = Panel(equals_9.Equality)
color_14 = GhPythonScript(panel=panel_14)  # inputs panel: Boolean; same code as color

# ----
# MANUAL TESTS THAT CHECK "Change
# Property Name" FUNCTIONALITY
# Rename Name to FullName  (connected)
# Rename Age to AgeInYears (All)
# Rename Speciality (Musician) to Instrument (Just this type)
# Rename Speciality to SpecialDish  (connected)
# Now undo (4x) and redo (4x) on all changes,
# and check it behaves correctly
number_slider_3 = Slider(64, range=0..100)
person_4 = CreateObject(FullName="Bob", AgeInYears=Slider(36, range=0..100))
chef = CreateObject(Name="Gordon Ramsey", AgeInYears=number_slider_3, SpecialDish="Burger")
person_5 = CreateObject(FullName="Babs", AgeInYears=Slider(67, range=0..100))
musician = CreateObject(FullName="Betty", AgeInYears=Slider(17, range=0..100), Instrument="Viola")
chef_2 = GetObjectProperties(Object=chef, GraftItemsToggle=False)  # -> Name, AgeInYears, SpecialDish
add_change_2 = AddOrChangeProperties(Object=person_4, PropertyToChange="Bill")
add_change_3 = AddOrChangeProperties(Object=musician, PropertyToChange="Bill")
coder_3 = Inherit(Object=person_5, PropertyToChange="Haskell")
nn = GhPythonScript(param=chef_2.SpecialDish)  # -> nickname; inputs param: tree
# ---------- nn: Python ----------
nickname = ghenv.Component.Params.Input[0].Sources[0].NickName
# ---------- end nn ----------
merge_5 = Merge(Data1=add_change_2, Data2=coder_3, Data3=add_change_3)
equals_10 = Equality(FirstNumber=chef_2.AgeInYears, SecondNumber=number_slider_3)  # -> Equality, Inequality
tmatch_3 = MatchText(Text="Gordon Ramsey", Pattern=chef_2.Name, Case=True)
tmatch_4 = MatchText(Text=chef_2.SpecialDish, Pattern="Burger", Case=True)
nn_2 = GhPythonScript(param=chef_2.Name)  # -> nickname; inputs param: tree; same code as nn
filter_2 = FilterByType(Object=graft(merge_5))  # -> Person, Coder, Musician
mm_3 = MassMultiplication(Input=[tmatch_3, equals_10.Equality, tmatch_4])  # -> Result, PartialResults
tmatch_5 = MatchText(Text=nn, Pattern="SpecialDish", Case=True)
tmatch_6 = MatchText(Text=nn_2, Pattern="Name", Case=True)
bool_3 = Boolean(mm_3.Result)
panel_15 = Panel(tmatch_6)
panel_16 = Panel(tmatch_5)
panel_17 = Panel(bool_3)
manualassert_renaming = RemoteSender(tmatch_6)
manualassert_renaming_2 = RemoteSender(tmatch_5)
multipletypes = GetObjectProperties(Object=[filter_2.Musician, filter_2.Coder, filter_2.Person], GraftItemsToggle=False)  # -> FullName, AgeInYears
musician_2 = GetObjectProperties(Object=filter_2.Musician, GraftItemsToggle=False)
assert_renaming = RemoteSender(mm_3.Result)
coder_4 = GetObjectProperties(Object=filter_2.Coder, GraftItemsToggle=False)
color_15 = GhPythonScript(panel=panel_17)  # inputs panel: Boolean; same code as color
color_16 = GhPythonScript(panel=panel_15)  # inputs panel: Boolean; same code as color
color_17 = GhPythonScript(panel=panel_16)  # inputs panel: Boolean; same code as color
nn_3 = GhPythonScript(param=[chef_2.AgeInYears, multipletypes.AgeInYears])  # -> nickname; inputs param: tree; same code as nn
nn_4 = GhPythonScript(param=flatten(multipletypes.FullName))  # -> nickname; inputs param: tree; same code as nn
nn_5 = GhPythonScript(param=flatten(musician_2))  # -> nickname; inputs param: tree; same code as nn
tmatch_7 = MatchText(Text=nn_3, Pattern="AgeInYears", Case=True)
tmatch_8 = MatchText(Text=coder_4, Pattern="Haskell", Case=True)
tmatch_9 = MatchText(Text=musician_2, Pattern="Viola", Case=True)
mm_4 = MassMultiplication(Input=flatten(tmatch_7))  # -> Result, PartialResults
tmatch_10 = MatchText(Text=nn_4, Pattern="FullName", Case=True)
tmatch_11 = MatchText(Text=nn_5, Pattern="Instrument", Case=True)
bool_4 = Boolean(mm_4.Result)
bool_5 = Boolean(tmatch_8)
bool_6 = Boolean(tmatch_9)
panel_18 = Panel(bool_5)
panel_19 = Panel(bool_6)
panel_20 = Panel(tmatch_10)
panel_21 = Panel(bool_4)
panel_22 = Panel(tmatch_11)
manualassert_renaming_3 = RemoteSender(tmatch_10)
manualassert_renaming_4 = RemoteSender(bool_4)
manualassert_renaming_5 = RemoteSender(tmatch_11)
assert_renaming_2 = RemoteSender(tmatch_8)
assert_renaming_3 = RemoteSender(tmatch_9)
color_18 = GhPythonScript(panel=panel_18)  # inputs panel: Boolean; same code as color
color_19 = GhPythonScript(panel=panel_22)  # inputs panel: Boolean; same code as color
color_20 = GhPythonScript(panel=panel_19)  # inputs panel: Boolean; same code as color
color_21 = GhPythonScript(panel=panel_20)  # inputs panel: Boolean; same code as color
color_22 = GhPythonScript(panel=panel_21)  # inputs panel: Boolean; same code as color

# ----
# TEST RESULTS
# ALL AUTOMATED TEST PASS
# ALL MANUAL TEST PASS
manualassert = RemoteReceiver([manualassert_renaming, manualassert_renaming_2, manualassert_renaming_4, manualassert_renaming_3, manualassert_renaming_5])
assert = RemoteReceiver([assert_referencedgeometrynotnull, assert_notnull, assert_internalisedgeometrynotnull, assert_notnull_2, assert_insameplace, assert_itemaccessworks, assert_treeaccess, assert_listaccess, assert_itemgraftedaccess_2, assert_namewaschanged, assert_implements, assert_implements_2, assert_isbabs, assert_itemgraftedaccess, assert_renaming, assert_renaming_3, assert_renaming_2])
mm_5 = MassMultiplication(Input=flatten(assert))  # -> Result, PartialResults
mm_6 = MassMultiplication(Input=flatten(manualassert))  # -> Result, PartialResults
bool_7 = Boolean(mm_5.Result)
bool_8 = Boolean(mm_6.Result)
panel_23 = Panel(bool_8)
panel_24 = Panel(bool_7)
color_23 = GhPythonScript(panel=panel_23)  # inputs panel: Boolean; same code as color
color_24 = GhPythonScript(panel=panel_24)  # inputs panel: Boolean; same code as color
