# Grasshopper definition full-test-suite.gh (Grasshopper 1.0.7)
# plug-ins: Objectivism, Telepathy

# Tree behaviour
number_slider = Slider(5, range=0..10)
# Referenced geometry - requires rhino file to be open
brep = Brep(<brep referenced from the Rhino model>)
subd = SubD(<subd referenced from the Rhino model>)
mesh = Mesh(<mesh referenced from the Rhino model>)
pt = Point(<point referenced from the Rhino model>)
crv = Curve(<curve referenced from the Rhino model>)
# Internalised geometry + transforms and morphs
brep_2 = Brep(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)
subd_2 = SubD(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)
mesh_2 = Mesh(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)
pt_2 = Point(Point(19.68175559, -7.131460642, 0))
crv_2 = Curve(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)
# Polymorphism
panel = Panel("Bob")
# Internalised object
internalised_object = Data(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)
# Rename Speciality to Special Dish  (connected)
# Now undo (4x) and redo (4x) on all changes,
# and check it behaves correctly
number_slider_2 = Slider(64, range=0..100)
person = CreateObject(FullName="Babs", AgeInYears=Slider(67, range=0..100))
person_2 = CreateObject(FullName=panel, AgeInYears=Slider(36, range=0..100))
object = CreateObject(Brep=brep, SubD=subd, Mesh=mesh, Pt=pt, Crv=crv)
object_2 = GetObjectProperties(Object=internalised_object, GraftItemsToggle=False)  # -> Name, Brep, SubD, Mesh, Pt, Crv
series = Series(Start=0, Step=1, Count=Slider(3, range=0..10))
series_2 = Series(Start=0, Step=1, Count=Slider(5, range=0..10))
# Rename Speciality (Musician )to Instrument (Just this type)
number_slider_3 = Slider(17, range=0..100)
# Rename Age to AgeInYears (All)
number_slider_4 = Slider(67, range=0..100)
object_3 = GetObjectProperties(Object=object, GraftItemsToggle=False)  # -> Brep, SubD, Mesh, Pt, Crv
object_4 = CreateObject(Brep=brep_2, SubD=subd_2, Mesh=mesh_2, Pt=pt_2, Crv=crv_2)
trim = TrimTree(Tree=series, Depth=1)  # -> graft(Tree)
null = NullItem(Item=flatten([object_2.Brep, object_2.SubD, object_2.Mesh, object_2.Pt, object_2.Crv, object_2.Name]))  # -> NullFlags, InvalidFlags, Description
merge = Merge(Data1=brep_2, Data2=subd_2, Data3=mesh_2, Data4=pt_2, Data5=crv_2)
coder = Inherit(Object=person, FavouriteLanguage="BrainF**k")
add_change = AddOrChangeProperties(Object=person_2, PropertyToChange="Bill")
person_3 = CreateObject(FullName="Bob", AgeInYears=Slider(36, range=0..100))
chef = CreateObject(Name="Gordon Ramsey", AgeInYears=number_slider_2, SpecialDish="Burger")
person_4 = CreateObject(FullName="Babs", AgeInYears=number_slider_4)
ma = MassAddition(Input=null.NullFlags)  # -> Result, PartialResults
musician = CreateObject(FullName="Betty", AgeInYears=number_slider_3, Instrument="Viola")
group = Group(Objects=merge)
series_3 = Series(Start=trim, Step=1, Count=Slider(5, range=0..10))
null_2 = NullItem(Item=flatten([object_3.Brep, object_3.SubD, object_3.Mesh, object_3.Pt, object_3.Crv]))  # -> NullFlags, InvalidFlags, Description
equals = Equality(FirstNumber=ma.Result, SecondNumber=0)  # -> Equality, Inequality
object_5 = GetObjectProperties(Object=object_4, GraftItemsToggle=False)  # -> Brep, SubD, Mesh, Pt, Crv
trim_2 = TrimTree(Tree=series_3, Depth=1)
ma_2 = MassAddition(Input=null_2.NullFlags)  # -> Result, PartialResults
chef_2 = GetObjectProperties(Object=chef, GraftItemsToggle=False)  # -> Name, AgeInYears, SpecialDish
assert_internalisedgeometrynotnull = RemoteSender(equals.Equality)
panel_2 = Panel(equals.Equality)
implements = Implements(Template=person, Object=coder)
implements_2 = Implements(Template=coder, Object=person)
equals_2 = Equality(FirstNumber=ma_2.Result, SecondNumber=0)  # -> Equality, Inequality
add_change_2 = AddOrChangeProperties(Object=person_3, PropertyToChange="Bill")
add_change_3 = AddOrChangeProperties(Object=musician, PropertyToChange="Bill")
coder_2 = Inherit(Object=person_4, PropertyToChange="Haskell")
null_3 = NullItem(Item=flatten([object_5.Brep, object_5.SubD, object_5.Mesh, object_5.Pt, object_5.Crv]))  # -> NullFlags, InvalidFlags, Description
object_6 = CreateObject(Item=number_slider, List=series_2, Tree=trim_2)
filter = FilterByType(Object=graft([add_change, coder]))  # -> Person, Coder
not = GateNot(A=implements_2)
assert_referencedgeometrynotnull = RemoteSender(equals_2.Equality)
panel_3 = Panel(equals_2.Equality)
ma_3 = MassAddition(Input=null_3.NullFlags)  # -> Result, PartialResults
color = GhPythonScript(panel=panel_2)  # inputs panel: Boolean
# ---------- color: Python ----------
import System.Drawing as sd



color = sd.Color.FromArgb(255,0,255,0) if panel else sd.Color.Red

ghenv.Component.Params.Input[0].Sources[0].Properties.Colour = color
# ---------- end color ----------
panel_4 = Panel(implements)
panel_5 = Panel(not)
assert_implements = RemoteSender(implements)
assert_implements_2 = RemoteSender(not)
merge_2 = Merge(Data1=object_6, Data2=object_6)
equals_3 = Equality(FirstNumber=ma_3.Result, SecondNumber=0)  # -> Equality, Inequality
coder_3 = GetObjectProperties(Object=filter.Coder, GraftItemsToggle=False)
person_5 = GetObjectProperties(Object=filter.Person, GraftItemsToggle=False)
color_2 = GhPythonScript(panel=panel_3)  # inputs panel: Boolean; same code as color
entwine = Entwine(Branch00=object_6, Branch01=merge_2, FlattenInputs=True)
nn = GhPythonScript(param=chef_2.SpecialDish)  # -> nickname; inputs param: tree
# ---------- nn: Python ----------
nickname = ghenv.Component.Params.Input[0].Sources[0].NickName
# ---------- end nn ----------
merge_3 = Merge(Data1=add_change_2, Data2=coder_2, Data3=add_change_3)
equals_4 = Equality(FirstNumber=chef_2.AgeInYears, SecondNumber=number_slider_2)  # -> Equality, Inequality
tmatch = MatchText(Text="Gordon Ramsey", Pattern=chef_2.Name, Case=True)
tmatch_2 = MatchText(Text=chef_2.SpecialDish, Pattern="Burger", Case=True)
color_3 = GhPythonScript(panel=panel_4)  # inputs panel: Boolean; same code as color
nn_2 = GhPythonScript(param=chef_2.Name)  # -> nickname; inputs param: tree; same code as nn
color_4 = GhPythonScript(panel=panel_5)  # inputs panel: Boolean; same code as color
assert_notnull = RemoteSender(equals_3.Equality)
panel_6 = Panel(equals_3.Equality)
tmatch_3 = MatchText(Text=coder_3, Pattern="Babs", Case=True)
tmatch_4 = MatchText(Text=person_5, Pattern="Bill", Case=True)
filter_2 = FilterByType(Object=graft(merge_3))  # -> Person, Coder, Musician
mm = MassMultiplication(Input=[tmatch, equals_4.Equality, tmatch_2])  # -> Result, PartialResults
tmatch_5 = MatchText(Text=nn, Pattern="SpecialDish", Case=True)
tmatch_6 = MatchText(Text=nn_2, Pattern="Name", Case=True)
color_5 = GhPythonScript(panel=panel_6)  # inputs panel: Boolean; same code as color
object_7 = GetObjectProperties(Object=entwine, GraftItemsToggle=True)  # -> Item, List, Tree
bool = Boolean(mm.Result)
panel_7 = Panel(tmatch_3)
panel_8 = Panel(tmatch_4)
assert_namewaschanged = RemoteSender(tmatch_4)
panel_9 = Panel(tmatch_5)
manualassert_renaming = RemoteSender(tmatch_5)
assert_isbabs = RemoteSender(tmatch_3)
panel_10 = Panel(tmatch_6)
manualassert_renaming_2 = RemoteSender(tmatch_6)
panel_11 = Panel(bool)
assert_renaming = RemoteSender(mm.Result)
multipletypes = GetObjectProperties(Object=[filter_2.Musician, filter_2.Coder, filter_2.Person], GraftItemsToggle=False)  # -> FullName, AgeInYears
coder_4 = GetObjectProperties(Object=filter_2.Coder, GraftItemsToggle=False)
object_8 = GetObjectProperties(Object=entwine, GraftItemsToggle=False)
musician_2 = GetObjectProperties(Object=filter_2.Musician, GraftItemsToggle=False)
xz = XZPlane(Origin=Point(0, 0, 0))
crv_3 = Curve(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)
color_6 = GhPythonScript(panel=panel_7)  # inputs panel: Boolean; same code as color
color_7 = GhPythonScript(panel=panel_8)  # inputs panel: Boolean; same code as color
color_8 = GhPythonScript(panel=panel_9)  # inputs panel: Boolean; same code as color
color_9 = GhPythonScript(panel=panel_10)  # inputs panel: Boolean; same code as color
lng = ListLength(List=entwine)
lng_2 = ListLength(List=object_8)
color_10 = GhPythonScript(panel=panel_11)  # inputs panel: Boolean; same code as color
totree = ObjectToTree(Object=object_6)  # -> Tree, PropertyNames
correctdata = Data(Tree({0;0;0;0}: [5], {1;0;0;0}: [0, 1, 2, 3, 4], {2;0;0;0;0;0}: [0, 1, 2, 3, 4], {2;0;0;0;0;1}: [1, 2, 3, 4, 5], {2;0;0;0;0;2}: [2, 3, 4, 5, 6]))
# Transform
mirror = Mirror(Geometry=group, Plane=xz)  # -> Geometry, Transform
mirror_2 = Mirror(Geometry=object_4, Plane=xz)  # -> Geometry, Transform
# Morph
bend = BendDeform(Geometry=group, BendingArc=crv_3)
bend_2 = BendDeform(Geometry=object_4, BendingArc=crv_3)
item = TreeItem(Tree=object_7.Tree, Path="{0;1;1;0;1}", Index=0, Wrap=True)
equals_5 = Equality(FirstNumber=lng_2, SecondNumber=lng)  # -> Equality, Inequality
branch = TreeBranch(Tree=object_7.Item, Path="{0;1;1}", MaintainPaths=True)
branch_2 = TreeBranch(Tree=object_7.List, Path="{0;1;1}", MaintainPaths=True)
object_9 = GetObjectProperties(Object=mirror_2.Geometry, GraftItemsToggle=False)  # -> Brep, SubD, Mesh, Pt, Crv
object_10 = GetObjectProperties(Object=bend_2, GraftItemsToggle=False)  # -> Brep, SubD, Mesh, Pt, Crv
nn_3 = GhPythonScript(param=[chef_2.AgeInYears, multipletypes.AgeInYears])  # -> nickname; inputs param: tree; same code as nn
equals_6 = Equality(FirstNumber=totree.Tree, SecondNumber=correctdata)  # -> Equality, Inequality
lng_3 = ListLength(List=branch)
lng_4 = ListLength(List=branch_2)
mm_2 = MassMultiplication(Input=flatten(equals_5.Equality))  # -> Result, PartialResults
equals_7 = Equality(FirstNumber=item, SecondNumber=1)  # -> Equality, Inequality
merge_4 = Merge(Data1=object_9.Brep, Data2=object_9.SubD, Data3=object_9.Mesh, Data4=object_9.Pt, Data5=object_9.Crv)
merge_5 = Merge(Data1=object_10.Brep, Data2=object_10.SubD, Data3=object_10.Mesh, Data4=object_10.Pt, Data5=object_10.Crv)
ungroup = Ungroup(Group=mirror.Geometry)
ungroup_2 = Ungroup(Group=bend)
mm_3 = MassMultiplication(Input=flatten(equals_6.Equality))  # -> Result, PartialResults
equals_8 = Equality(FirstNumber=lng_3, SecondNumber=1)  # -> Equality, Inequality
equals_9 = Equality(FirstNumber=lng_4, SecondNumber=5)  # -> Equality, Inequality
bool_2 = Boolean(mm_2.Result)
nn_4 = GhPythonScript(param=flatten(multipletypes.FullName))  # -> nickname; inputs param: tree; same code as nn
nn_5 = GhPythonScript(param=flatten(musician_2))  # -> nickname; inputs param: tree; same code as nn
tmatch_7 = MatchText(Text=nn_3, Pattern="AgeInYears", Case=True)
bool_3 = Boolean(mm_3.Result)
tmatch_8 = MatchText(Text=coder_4, Pattern="Haskell", Case=True)
tmatch_9 = MatchText(Text=musician_2, Pattern="Viola", Case=True)
mm_4 = MassMultiplication(Input=flatten(tmatch_7))  # -> Result, PartialResults
panel_12 = Panel(bool_3)
assert_itemgraftedaccess = RemoteSender(bool_3)
panel_13 = Panel(equals_8.Equality)
panel_14 = Panel(equals_9.Equality)
assert_itemgraftedaccess_2 = RemoteSender(equals_8.Equality)
assert_listaccess = RemoteSender(equals_9.Equality)
assert_treeaccess = RemoteSender(equals_7.Equality)
assert_itemaccessworks = RemoteSender(bool_2)
panel_15 = Panel(equals_7.Equality)
panel_16 = Panel(bool_2)
entwine_2 = Entwine(Branch00=ungroup, Branch01=ungroup_2, FlattenInputs=True)
entwine_3 = Entwine(Branch00=merge_4, Branch01=merge_5, FlattenInputs=True)
tmatch_10 = MatchText(Text=nn_4, Pattern="FullName", Case=True)
tmatch_11 = MatchText(Text=nn_5, Pattern="Instrument", Case=True)
bool_4 = Boolean(mm_4.Result)
bool_5 = Boolean(tmatch_8)
bool_6 = Boolean(tmatch_9)
panel_17 = Panel(tmatch_10)
panel_18 = Panel(bool_5)
panel_19 = Panel(bool_6)
manualassert_renaming_3 = RemoteSender(tmatch_10)
color_11 = GhPythonScript(panel=panel_12)  # inputs panel: Boolean; same code as color
color_12 = GhPythonScript(panel=panel_13)  # inputs panel: Boolean; same code as color
color_13 = GhPythonScript(panel=panel_14)  # inputs panel: Boolean; same code as color
color_14 = GhPythonScript(panel=panel_15)  # inputs panel: Boolean; same code as color
color_15 = GhPythonScript(panel=panel_16)  # inputs panel: Boolean; same code as color
assert_renaming_2 = RemoteSender(tmatch_8)
assert_renaming_3 = RemoteSender(tmatch_9)
panel_20 = Panel(bool_4)
panel_21 = Panel(tmatch_11)
manualassert_renaming_4 = RemoteSender(tmatch_11)
manualassert_renaming_5 = RemoteSender(bool_4)
# Polymorphism
# ALL MANUAL TEST PASS
# Rename Name to FullName  (connected)
manualassert = RemoteReceiver([manualassert_renaming_2, manualassert_renaming, manualassert_renaming_5, manualassert_renaming_3, manualassert_renaming_4])
mm_5 = MassMultiplication(Input=flatten(manualassert))  # -> Result, PartialResults
bool_7 = Boolean(mm_5.Result)
panel_22 = Panel(bool_7)
color_16 = GhPythonScript(panel=panel_22)  # inputs panel: Boolean; same code as color
bbox = BoundingBox(Content=entwine_2, Plane=PlaneXY(0, 0, 0))  # -> Box, Box_2
bbox_2 = BoundingBox(Content=entwine_3, Plane=PlaneXY(0, 0, 0))  # -> Box, Box_2
null_4 = NullItem(Item=entwine_3)  # -> NullFlags, InvalidFlags, Description
ma_4 = MassAddition(Input=flatten(null_4.NullFlags))  # -> Result, PartialResults
boxprop = BoxProperties(Box=bbox_2.Box)  # -> Center, Diagonal, Area, Volume, Degeneracy
boxprop_2 = BoxProperties(Box=bbox.Box)  # -> Center, Diagonal, Area, Volume, Degeneracy
color_17 = GhPythonScript(panel=panel_17)  # inputs panel: Boolean; same code as color
color_18 = GhPythonScript(panel=panel_18)  # inputs panel: Boolean; same code as color
color_19 = GhPythonScript(panel=panel_19)  # inputs panel: Boolean; same code as color
color_20 = GhPythonScript(panel=panel_20)  # inputs panel: Boolean; same code as color
color_21 = GhPythonScript(panel=panel_21)  # inputs panel: Boolean; same code as color
equals_10 = Equality(FirstNumber=ma_4.Result, SecondNumber=0)  # -> Equality, Inequality
dist = Distance(PointA=boxprop_2.Center, PointB=boxprop.Center)
assert_notnull_2 = RemoteSender(equals_10.Equality)
panel_23 = Panel(equals_10.Equality)
ma_5 = MassAddition(Input=flatten(dist))  # -> Result, PartialResults
smaller = SmallerThan(FirstNumber=ma_5.Result, SecondNumber="0.0001")  # -> SmallerThan, OrEqualTo
color_22 = GhPythonScript(panel=panel_23)  # inputs panel: Boolean; same code as color
assert_insameplace = RemoteSender(smaller.SmallerThan)
# ALL AUTOMATED TEST PASS
assert = RemoteReceiver([assert_referencedgeometrynotnull, assert_notnull, assert_internalisedgeometrynotnull, assert_notnull_2, assert_insameplace, assert_itemaccessworks, assert_treeaccess, assert_listaccess, assert_itemgraftedaccess_2, assert_namewaschanged, assert_implements, assert_implements_2, assert_isbabs, assert_itemgraftedaccess, assert_renaming, assert_renaming_3, assert_renaming_2])
mm_6 = MassMultiplication(Input=flatten(assert))  # -> Result, PartialResults
bool_8 = Boolean(mm_6.Result)
panel_24 = Panel(bool_8)
color_23 = GhPythonScript(panel=panel_24)  # inputs panel: Boolean; same code as color
panel_25 = Panel(smaller.SmallerThan)
color_24 = GhPythonScript(panel=panel_25)  # inputs panel: Boolean; same code as color
